# Dynamo custom node AddPSETsToObjects.dyf (Dynamo 2.19.4.6671)
# category: yourC3DFeeder.PSET

YourObjects = Input(YourObjects: var[]..[])
ObjectsPSETSNames = Input(ObjectsPSETSNames: var[]..[])
count = List.Count(list=ObjectsPSETSNames@L2)
ofRepeatedItem = List.OfRepeatedItem(item=YourObjects@@L2, amount=count, lacing=Shortest)
addPropertySet = Autodesk.AutoCAD.DynamoNodes.Object.AddPropertySet(object=ofRepeatedItem@L3, propertySetDefinitionName=ObjectsPSETSNames@L2, lacing=Shortest)
firstItem = List.FirstItem(list=addPropertySet@L3)
python_script = Python(IN[0]=firstItem)  # CPython3
# ---------- python_script.python (23 lines) ----------
# Load the Python Standard and DesignScript Libraries
import sys
import clr

# Input: IN[0] - list of items (some may be None/null)

input_list = IN[0]

result = []
default_output = []
# Validate input
if not isinstance(input_list, list):
    result = "Input must be a list."
else:
    for item in input_list:
        if item is None:
            result.append(default_output)
        elif isinstance(item, dict):
            result.append(item)
        else:
            result.append(item)  # keep other non-null values as-is if needed

OUT = result
# ----------------------------------------
ObjectsWithPSETs = Output(python_script)
