# Dynamo custom node AddPropertiesToObjects.dyf (Dynamo 2.19.4.6671)
# category: yourC3DFeeder.PSET
# packages: Civil3DToolkit 1.1.32

ObjectsWithPSETs = Input(ObjectsWithPSETs: var[]..[])
PSETsDefinitionsByLayer = Input(PSETsDefinitionsByLayer: var[]..[])
python_script = Python(IN[0]=ObjectsWithPSETs, IN[1]=PSETsDefinitionsByLayer)  # CPython3
# ---------- python_script.python (74 lines) ----------
# Load the Python Standard and DesignScript Libraries
import sys
import clr

# Inputs:
# IN[0] = nested list of objects [[obj1, obj2], [obj3, obj4, ...], ...]
# IN[1] = JSON dictionary as described

def convert_netdict_to_pydict(net_dict):
    py_dict = {}
    for key in net_dict.Keys:
        py_dict[key] = net_dict[key]
    return py_dict


object_groups = IN[0]
property_data = IN[1]


result = None  # Initialize

# Validate inputs
if not isinstance(object_groups, list):
    result = "Input[0] must be a list of object groups."
elif not all(isinstance(group, list) for group in object_groups):
    result = "Each item in Input[0] must be a list (group of objects)."
elif not isinstance(property_data, dict):
    result = "Input[1] must be a dictionary (parsed JSON)."
else:
    
    flat_objects = []
    flat_pset_names = []
    flat_prop_names = []
    flat_prop_values = []

      # Flatten the object list
    all_objects = [obj for group in object_groups for obj in group]

    for obj in all_objects:
        try:
            layer = obj.Layer
        except:
            continue  # Skip if no Layer

        if layer not in property_data:
            continue  # Skip if layer not defined

        layer_sets = convert_netdict_to_pydict(property_data[layer])
            
        for pset_name in layer_sets:
            properties = convert_netdict_to_pydict(layer_sets[pset_name])
            
            if not isinstance(properties, dict) or not properties:
                continue  # Skip empty or invalid property sets
            
            for prop_name in properties:
                prop_value = properties[prop_name]
                
                flat_objects.append(obj)
                flat_pset_names.append(pset_name)
                flat_prop_names.append(prop_name)
                flat_prop_values.append(prop_value)
              


    result = {
        "objects": flat_objects,
        "psetNames": flat_pset_names,
        "propertyNames": flat_prop_names,
        "propertyValues": flat_prop_values
    }

# Return only once
    OUT = result
# ----------------------------------------
code_block = CodeBlock(dic=python_script)
# ---------- code_block.designscript (4 lines) ----------
objects = DesignScript.Builtin.Dictionary.ValueAtKey(dic, "objects");
psets = DesignScript.Builtin.Dictionary.ValueAtKey(dic, "psetNames");
properties = DesignScript.Builtin.Dictionary.ValueAtKey(dic, "propertyNames");
values = DesignScript.Builtin.Dictionary.ValueAtKey(dic, "propertyValues");
# ----------------------------------------
setPropertyValueByName = Autodesk.AutoCAD.DynamoNodes.PropertySetsExtensions.SetPropertyValueByName(obj=code_block.objects, propertySetName=code_block.psets, propertyName=code_block.properties, propertyValue=code_block.values)
uniqueItems = List.UniqueItems(list=setPropertyValueByName)
Objects = Output(uniqueItems)
