# Dynamo custom node PrepareObjectsPSETs.dyf (Dynamo 2.19.4.6671)
# category: yourC3DFeeder.JSON

JSONString = Input(JSONString: var[]..[])
python_script = Python(IN[0]=JSONString)  # CPython3
# ---------- python_script.python (68 lines) ----------
import json
import copy

def resolve_psets(data):
    resolved = {}

    def collect_all_psets_and_props(name, visited=None):
        if visited is None:
            visited = set()
        if name in visited or name not in data:
            return set(), {}
        visited.add(name)

        obj = data[name]
        local_psets = set(obj.get("psets", []))
        # local_props = obj.get("props", {}).copy()
        local_props = copy.deepcopy(obj.get("props", {}))

        # Recursively collect from members
        for member in obj.get("members", []):
            member_psets, member_props = collect_all_psets_and_props(member, visited)
            local_psets.update(member_psets)
            
            #BUG 001 REPAIRED - MERGING props definition in different locations
            for key, val in member_props.items():
                if key in local_props:
                    # Merge dictionaries if the pset already exists
                    # Make sure the props definition always wins over ancestors definitions in members
                    merged = copy.deepcopy(val)
                    merged.update(local_props[key])
                    local_props[key] = merged
                else:
                    local_props[key] = val
            #BUG 001 REPAIRED - 


        # Add any psets that appear in props but not declared in psets
        local_psets.update(local_props.keys())

        return local_psets, local_props

    def build_props(name):
        visited = set()  # Each top-level element gets its own visited tracker
        psets, props = collect_all_psets_and_props(name, visited)
        result = {}
        for pset in psets:
            result[pset] = props.get(pset, {})
        return result


    for key in data:
        if key == "PSETS":
            continue
        resolved[key] = build_props(key)

    return resolved

# Main Dynamo input/output
json_string = IN[0]

try:
    data = json.loads(json_string)
    #data = json_string
    result = resolve_psets(data)
except Exception as e:
    result = {"error": str(e)}

OUT = result
# ----------------------------------------
PSETsDefinitionsByLayer = Output(python_script)
