# Dynamo custom node PreparePSETsNames.dyf (Dynamo 2.19.4.6671)
# category: yourC3DFeeder.PSET

PSETsDefinitionsByLayer = Input(PSETsDefinitionsByLayer: var[]..[])
uniqueObjectsLayers = Input(uniqueObjectsLayers: var[]..[])
valueAtKey = DesignScript.Builtin.Dictionary.ValueAtKey(dictionary=PSETsDefinitionsByLayer, key=uniqueObjectsLayers)
python_script = Python(IN[0]=valueAtKey)  # CPython3
# ---------- python_script.python (23 lines) ----------
# Load the Python Standard and DesignScript Libraries
import sys
import clr

# Input: IN[0] - list of items (some may be None/null)

input_list = IN[0]

result = []

# Validate input
if not isinstance(input_list, list):
    result = "Input must be a list."
else:
    for item in input_list:
        if item is None:
            result.append({})
        elif isinstance(item, dict):
            result.append(item)
        else:
            result.append(item)  # keep other non-null values as-is if needed

OUT = result
# ----------------------------------------
dictionary_keys_pset_keys_names = DesignScript.Builtin.Dictionary.Keys(dictionary=python_script@L1)
PSETsNames = Output(dictionary_keys_pset_keys_names)
python_script_2 = Python(IN[0]=PSETsDefinitionsByLayer, IN[1]=uniqueObjectsLayers)  # CPython3
# ---------- python_script_2.python (16 lines) ----------
psetDefsDic = IN[0]
objLays = IN[1]

result = []

# Validate input
if not isinstance(objLays, list):
    result = "Input must be a list."
else:
    for objLay in objLays:
        try:
            test = psetDefsDic[objLay]
        except:
            result.append(objLay)    

OUT = result
# ----------------------------------------
missingLayersDefinitions = Output(python_script_2)
