# Dynamo custom node cleanJSONC.dyf (Dynamo 2.19.4.6671)
# category: yourC3DFeeder.JSON
# Create a valid JSON string from JSONC string. What is JSONC? It a format allowing you to add comments like // a comment or /* a multiline comment  */ and comments are not valid when parsing JSON - so you need to get rid of them.

jsonStringWithComments = Input(jsonStringWithComments: var[]..[])
python_script = Python(IN[0]=jsonStringWithComments)  # CPython3
# ---------- python_script.python (33 lines) ----------
import re

def remove_jsonc_comments(jsonc_string):
    # Remove multiline comments (/* ... */)
    jsonc_string = re.sub(r'/\*.*?\*/', '', jsonc_string, flags=re.DOTALL)
    # Remove single-line comments (//...) that are not in string literals
    def strip_line_comments(line):
        in_str = False
        escape = False
        for i in range(len(line)):
            char = line[i]
            if char == '"' and not escape:
                in_str = not in_str
            if char == '\\' and not escape:
                escape = True
                continue
            if not in_str and line[i:i+2] == '//':
                return line[:i]
            escape = False
        return line

    lines = jsonc_string.splitlines()
    cleaned_lines = [strip_line_comments(line) for line in lines]
    return '\n'.join(cleaned_lines)

# Dynamo input
jsonc_string = IN[0]

# Process
clean_json_string = remove_jsonc_comments(jsonc_string)

# Dynamo output
OUT = clean_json_string
# ----------------------------------------
JSONString = Output(python_script)
