# Dynamo custom node exportProcessedPSETsJSON.dyf (Dynamo 2.19.4.6671)
# category: yourC3DFeeder.JSON
# packages: JsonData 2.0.2

PSETsDictionary = Input(PSETsDictionary: var[]..[])
byDictionary = JsonData.Elements.JsonObject.ByDictionary(dictionary=PSETsDictionary)
path = Input(path: var[]..[])
code_block = CodeBlock { "."; }
split = String.Split(string=path, separator0=code_block)
code_block_2 = CodeBlock { -1; }
dropItems = List.DropItems(list=split, amount=code_block_2)
firstItem = List.FirstItem(list=dropItems)
code_block_3 = CodeBlock { "-processed.json"; }
concat = String.Concat(string0=firstItem, string1=code_block_3)
toJsonFile = JsonData.Utilities.Write.ToJsonFile(jsonObjects=byDictionary, filepath=concat)
filepath = Output(toJsonFile)
