# Dynamo custom node prepareObjectsAndLayers.dyf (Dynamo 2.19.4.6671)
# category: yourC3DFeeder.PSET

objects = Input(objects: var[]..[])
layer = Autodesk.AutoCAD.DynamoNodes.Object.Layer(object=objects)
code_block = CodeBlock { "_"; }
contains = String.Contains(string=layer, searchFor=code_block)
filterByBoolMask = List.FilterByBoolMask(list=objects, mask=contains)
layer_2 = Autodesk.AutoCAD.DynamoNodes.Object.Layer(object=filterByBoolMask.in)
code_block_2 = CodeBlock { "_"; }
split = String.Split(string=layer_2, separator0=code_block_2)
lastItem = List.LastItem(list=split@L2)
code_block_3 = CodeBlock(items=lastItem) { items; }
# note: TODO:
# •  what if you cannot assign pset to an object
# •  what if property name is different from json
# •  ...
current = Autodesk.AutoCAD.DynamoNodes.Document.Current()
create = Autodesk.AutoCAD.DynamoNodes.Layer.Create(name=code_block_3, document=current, lacing=Longest)
layer_3 = Autodesk.AutoCAD.DynamoNodes.Object.Layer(object=filterByBoolMask.out)
groupByKey = List.GroupByKey(list=filterByBoolMask.out, keys=layer_3)
isEmpty = List.IsEmpty(list=groupByKey.groups)
isNull = Object.IsNull(object=isEmpty)
code_block_4 = CodeBlock { []; }
if_ = RefactoredIf(test=isNull, true=code_block_4, false=groupByKey.groups)
setLayer = Autodesk.AutoCAD.DynamoNodes.Object.SetLayer(object=filterByBoolMask.in, layer=code_block_3)
groupByKey_2 = List.GroupByKey(list=setLayer, keys=code_block_3)
isEmpty_2 = List.IsEmpty(list=groupByKey_2.groups)
isNull_2 = Object.IsNull(object=isEmpty_2)
if_2 = RefactoredIf(test=isNull_2, true=code_block_4, false=groupByKey_2.groups)
join = List.Join(list0=if_, list1=if_2)
objects_2 = Output(join)  # "objects"
isEmpty_3 = List.IsEmpty(list=groupByKey.uniqueKeys)
isNull_3 = Object.IsNull(object=isEmpty_3)
if_3 = RefactoredIf(test=isNull_3, true=code_block_4, false=groupByKey.uniqueKeys)
isEmpty_4 = List.IsEmpty(list=groupByKey_2.uniqueKeys)
isNull_4 = Object.IsNull(object=isEmpty_4)
if_4 = RefactoredIf(test=isNull_4, true=code_block_4, false=groupByKey_2.uniqueKeys)
join_2 = List.Join(list0=if_3, list1=if_4)
layers = Output(join_2)
