# Dynamo custom node replacePlaceholders.dyf (Dynamo 2.19.4.6671)
# category: yourC3DFeeder.JSON

placeholdersJSONString = Input(placeholdersJSONString: var[]..[])
targetJSONString = Input(targetJSONString: var[]..[])
python_script = Python(IN[0]=placeholdersJSONString, IN[1]=targetJSONString)  # CPython3
# ---------- python_script.python (51 lines) ----------
import json
import re

# Assign inputs to local variables
replacement_str = IN[0]
target_str = IN[1]

# Default output
output = {
    "JSONString": None,
    "missingDefinitions": []
}

try:
    # Validate input types
    if not isinstance(replacement_str, str):
        output["JSONString"] = "Error: Replacement input must be a string"
    elif not isinstance(target_str, str):
        output["JSONString"] = "Error: Target JSON input must be a string"
    else:
        # Parse replacement string
        try:
            replacements = json.loads(replacement_str)
        except Exception as e:
            output["JSONString"] = "Error: Invalid replacement JSON - " + str(e)
            replacements = None

        if replacements is not None:
            missing_keys = set()
            
            # Define replacement function
            def replacer(match):
                key = match.group(1)
                if key in replacements:
                    return replacements[key]
                else:
                    missing_keys.add(key)
                    return match.group(0)  # Leave placeholder as-is

            try:
                updated_str = re.sub(r"\{\{(.*?)\}\}", replacer, target_str)
                output["JSONString"] = updated_str
                output["missingDefinitions"] = list(missing_keys)
            except Exception as e:
                output["JSONString"] = "Error: Regex substitution failed - " + str(e)

except Exception as e:
    output["JSONString"] = "Unexpected error: " + str(e)

# Final single OUT assignment
OUT = output
# ----------------------------------------
code_block = CodeBlock { "JSONString"; }
valueAtKey = DesignScript.Builtin.Dictionary.ValueAtKey(dictionary=python_script, key=code_block)
JSONString = Output(valueAtKey)
code_block_2 = CodeBlock { "missingDefinitions"; }
valueAtKey_2 = DesignScript.Builtin.Dictionary.ValueAtKey(dictionary=python_script, key=code_block_2)
missingDefinitions = Output(valueAtKey_2)
