# Dynamo graph yourC3DFeeder.dyn (Dynamo 2.19.4.6671)
# packages: Civil3DToolkit 1.1.32, yourC3DFeeder 1.0.1

# group: Inputs
file_path = Filename("..\..\..\..\..\Documents\DynamoC3DFeeder-1\samples\corridor\input\placeholders.json")
file_path_2 = Filename("..\..\..\..\..\Documents\DynamoC3DFeeder-1\samples\corridor\input\psetsdefs.jsonc")
select_objects = ObjectsSelection()  # 5 picked in the model

readText = FileSystem.ReadText(file=file_path)
readText_2 = FileSystem.ReadText(file=file_path_2)
# note: you need to get rid of all comments so you can parse json in dictionnary object
cleanJSONC = Custom[cleanJSONC](jsonStringWithComments=readText_2)  # package yourC3DFeeder; Create a valid JSON string from JSONC string. What is JSONC? It a format allowing you to add comments like // a comment or /* a multiline comment */ and comments are not valid when parsing JSON - so you need to get rid of them.
replacePlaceholders = Custom[replacePlaceholders](placeholdersJSONString=readText, targetJSONString=cleanJSONC)  # package yourC3DFeeder
# note: You used a placeholder in psets json definition but you forgot to place it in placeholders.json. This is just a simple check for you...
watch = Watch(replacePlaceholders.missingDefinitions)
# note: This create a JSON objects from your pset definitions. All ancestors, members and props definitions are merged into many objects.
prepareObjectsPSETs = Custom[PrepareObjectsPSETs](JSONString=replacePlaceholders.JSONString)  # package yourC3DFeeder
# note: Export the final JSON so you can check your definitions easily - the file is exported to the same folder as you input definitions.
exportProcessedPSETsJSON = Custom[exportProcessedPSETsJSON](path=file_path_2, PSETsDictionary=prepareObjectsPSETs)  # package yourC3DFeeder
prepareObjectsAndLayers = Custom[prepareObjectsAndLayers](objects=select_objects)  # package yourC3DFeeder
preparePSETsNames = Custom[PreparePSETsNames](PSETsDefinitionsByLayer=prepareObjectsPSETs, uniqueObjectsLayers=prepareObjectsAndLayers.layers)  # package yourC3DFeeder
addPSETsToObjects = Custom[AddPSETsToObjects](ObjectsPSETSNames=preparePSETsNames.PSETsNames, YourObjects=prepareObjectsAndLayers.objects)  # package yourC3DFeeder
addPropertiesToObjects = Custom[AddPropertiesToObjects](ObjectsWithPSETs=addPSETsToObjects, PSETsDefinitionsByLayer=prepareObjectsPSETs)  # package yourC3DFeeder
